# Grasshopper definition Belt_generator.gh (Grasshopper 1.0.7)
# plug-ins: Pufferfish

length = Slider(110, range=0..1000)
radius = Slider(20, range=0..52)
pt = ConstructPoint(XCoordinate=length, YCoordinate=radius, ZCoordinate=0)
pt_2 = ConstructPoint(XCoordinate=0, YCoordinate=expr("-x", radius), ZCoordinate=0)
pt_3 = ConstructPoint(XCoordinate=0, YCoordinate=radius, ZCoordinate=0)
pt_4 = ConstructPoint(XCoordinate=length, YCoordinate=expr("-x", radius), ZCoordinate=0)
pt_5 = ConstructPoint(XCoordinate=length, YCoordinate=radius, ZCoordinate=0)
arc = ArcSED(Start=pt_5, End=pt_4, Direction="{1,0,0}")  # -> Arc, Plane, Radius
rec_2pt = Rectangle2Pt(Plane=PlaneXY(0, 0, 0), PointA=pt_2, PointB=pt, Radius=0)  # -> Rectangle, Length
arc_2 = ArcSED(Start=pt_2, End=pt_3, Direction="{-1,0,0}")  # -> Arc, Plane, Radius
clscrv = CloseCurve(Curve=arc.Arc, CloseType=0, Bulge=0.5, Tolerance=0)  # -> Closed, R
clscrv_2 = CloseCurve(Curve=arc_2.Arc, CloseType=0, Bulge=0.5, Tolerance=0)  # -> Closed, R
merge = Merge(Data1=clscrv.Closed, Data2=rec_2pt.Rectangle, Data3=clscrv_2.Closed)
runion = RegionUnion(Curves=merge)

panel = Panel("112 - 12")
crv = Curve(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)
distance_b_pulleys = Slider(102, range=0..1000)
teeth_count = Slider(28, range=0..100)
crv_2 = Curve(runion)
pt_6 = ConstructPoint(XCoordinate=distance_b_pulleys, YCoordinate=0, ZCoordinate=0)
hframes = HorizontalFrames(Curve=crv_2, Count=Slider(155, range=0..1000))  # -> Frames, Parameters
dispatch = Dispatch(List=hframes.Frames, DispatchPattern=[True, False])  # -> ListA, ListB
number_slider = Slider(0.55, range=-5..6)

teeth_height = Slider(1.2, range=0..100)
teeth_width = Slider(1.16, range=0..100)
fillet_radius = Slider(0.502, range=0..100)
subtraction = Subtraction(A=arc_2.Radius, B=teeth_height)
subtraction_2 = Subtraction(A=subtraction, B=number_slider)
neg = Negative(Value=teeth_width)
neg_2 = Negative(Value=teeth_height)
cir = Circle(Plane=PlaneXY(0, 0, 0), Radius=subtraction_2)
xy = XYPlane(Origin=Point(0, 0, 0))
pt_7 = ConstructPoint(XCoordinate=neg, YCoordinate=neg_2, ZCoordinate=0)
pt_8 = ConstructPoint(XCoordinate=teeth_width, YCoordinate=teeth_height, ZCoordinate=0)
curvepoint = PointOnCurve(cir, parameter=1)
Y = UnitY(Factor=curvepoint)
rec_2pt_2 = Rectangle2Pt(Plane=xy, PointA=pt_7, PointB=pt_8, Radius=fillet_radius)  # -> Rectangle, Length
move = Move(Geometry=rec_2pt_2.Rectangle, Motion=Y)  # -> Geometry, Transform
arrpolar = PolarArray(Geometry=move.Geometry, Plane=PlaneXY(0, 0, 0), Count=teeth_count, Angle=6.283185307)  # -> Geometry, Transform
trim = TrimWithRegions(Curve=arrpolar.Geometry, Regions=cir)  # -> Inside, Outside
trim_2 = TrimWithRegions(Curve=cir, Regions=arrpolar.Geometry)  # -> Inside, Outside
geo = Geometry(trim.Outside)
geo_2 = Geometry(trim_2.Outside)
join = JoinCurves(Curves=flatten([geo, geo_2]), Preserve=False)

offset = OffsetCurve(Curve=crv_2, Distance=Slider(1.45, range=0..10), Corners=1)
pl = ConstructPlane(Origin=pt_6, XAxis=Vector(1, 0, 0), YAxis=Vector(0, 1, 0))

teeth_height_2 = Slider(1.2, range=0..100)
teeth_width_2 = Slider(1.16, range=0..100)
fillet_radius_2 = Slider(0.502, range=0..100)
neg_3 = Negative(Value=teeth_width_2)
neg_4 = Negative(Value=teeth_height_2)
cir_2 = Circle(Plane=pt_6, Radius=Slider(31, range=0..100))
xy_2 = XYPlane(Origin=Point(0, 0, 0))
pt_9 = ConstructPoint(XCoordinate=neg_3, YCoordinate=neg_4, ZCoordinate=0)
pt_10 = ConstructPoint(XCoordinate=teeth_width_2, YCoordinate=teeth_height_2, ZCoordinate=0)
curvepoint_2 = PointOnCurve(cir_2, parameter=1)
rec_2pt_3 = Rectangle2Pt(Plane=pl, PointA=pt_9, PointB=pt_10, Radius=fillet_radius_2)  # -> Rectangle, Length
Y_2 = UnitY(Factor=curvepoint_2)
move_2 = Move(Geometry=rec_2pt_3.Rectangle, Motion=Y_2)  # -> Geometry, Transform
arrpolar_2 = PolarArray(Geometry=move_2.Geometry, Plane=PlaneXY(0, 0, 0), Count=teeth_count, Angle=6.283185307)  # -> Geometry, Transform
trim_3 = TrimWithRegions(Curve=arrpolar_2.Geometry, Regions=cir_2)  # -> Inside, Outside
trim_4 = TrimWithRegions(Curve=cir_2, Regions=arrpolar_2.Geometry)  # -> Inside, Outside
geo_3 = Geometry(trim_3.Outside)
geo_4 = Geometry(trim_4.Outside)
join_2 = JoinCurves(Curves=flatten([geo_3, geo_4]), Preserve=False)

deplane = DeconstructPlane(Plane=dispatch.ListB)  # -> Origin, XAxis, YAxis, ZAxis
crv_3 = Curve(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)
area = Area(Geometry=crv_3)  # -> Area, Centroid
Y_3 = UnitY(Factor=number_slider)
ins = InsertItems(List=deplane.XAxis, Item="{1,0,0}", Indices=0, Wrap=True)
move_3 = Move(Geometry=area.Centroid, Motion=Y_3)  # -> Geometry, Transform
cull_i = CullIndex(List=ins, Indices=-1, Wrap=True)  # -> flatten(List)
angle = Angle(VectorA=deplane.XAxis, VectorB=cull_i, Plane=deplane.Origin)  # -> Angle, Reflex
item = ListItem(List=deplane.Origin, Index=0, Wrap=True)  # -> Item, Item1
angle_2 = Angle(VectorA=deplane.XAxis, VectorB=cull_i)  # -> Angle, Reflex
python = GhPythonScript(angles=angle.Angle, b_vecs=cull_i)  # -> out, new_vecs, flatten(dirs); inputs angles: list, b_vecs: list of Vector3d
# ---------- python: Python ----------
import math
import Rhino.Geometry as rg

new_vecs = []
dirs = []

def calc_kat(vec, a):
    new_x = vec.Length * math.sin(a)
    new_y = vec.Length * math.sin(math.pi/2 - a)
    return rg.Vector3d(new_x, new_y, 0)

def get_dir(vec):
    dir = "CCW"
    if vec.X >= 0:
        dir = "CW"
    return dir

for vec, a in zip(b_vecs, angles):
    new_x = calc_kat(vec, a)
    new_vecs.append(new_x)
    dirs.append(get_dir(new_x))
# ---------- end python ----------
dist = Distance(PointA=item.Item, PointB=item.Item1)
multiplication = Multiplication(A=dist, B=teeth_count)
move2pt = MoveToPoint(Geometry=crv_3, PointA=move_3.Geometry, PointB=deplane.Origin)  # -> Moved, Vector, Transform
deg = Degrees(Radians=angle_2.Angle)
belt_pitch = Panel(dist)
python_2 = GhPythonScript(pts=deplane.Origin, angles=deg, pts_dir=python.dirs)  # -> out, a; inputs pts: list of Point3d, angles: list, pts_dir: list
# ---------- python_2: Python ----------
new_angles = []

for pt, angle, dir in zip(pts, angles, pts_dir):
    if dir == "CCW":
        a = -angle
    else:
        a = angle
    new_angles.append(a)

a = new_angles
# ---------- end python_2 ----------
ma = MassAddition(Input=python_2.a)  # -> Result, flatten(PartialResults)
rotate = Rotate(Geometry=move2pt.Moved, Angle=expr("360-x", degrees(ma.PartialResults)), Plane=deplane.Origin)  # -> Geometry, Transform
merge_2 = Merge(Data1=rotate.Geometry, Data2=crv_2)
