# Grasshopper definition GearSimpulation.gh (Grasshopper 1.0.7)
# plug-ins: Linketix

number_slider = Slider(0.2, range=0..1)
hexagonal_triangles = HexagonalTriangles(Plane=PlaneXY(0, 0, 0), Length=1, ExtentX=2, ExtentY=2, Motion=number_slider)
crv = Curve(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)  # disabled
crv_2 = Curve(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)
crv_3 = Curve(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)
trigger = Trigger(Interval=2, TimerInterval=5, Target=python)  # disabled
speed = Slider(3, range=0.1..3)
rectangular_1 = Rectangular1(Plane=PlaneXY(0, 0, 0), Length=3, Width=1, ExtentX=3, ExtentY=3, Motion=number_slider)  # disabled
linkagefrompolyline = LinkageFromPolyline(PolyLine=<geometry referenced from the Rhino model>, Motion=number_slider)  # -> Layer1, Layer2, Collide
python = GhPythonScript(state=Toggle(True), crv=crv_2, speed=speed)  # -> out, a; inputs state: Boolean, crv: Curve
# ---------- python: Python ----------
import Rhino.Geometry as rg
import math
from scriptcontext import sticky


if state:
     sticky["angle"] += speed
     #a = sticky["angle"]
else:
    sticky["angle"] = 0

centpt = rg.AreaMassProperties.Compute(crv).Centroid
plane = rg.Plane(centpt, rg.Vector3d(0, 0, 1))
geo = crv

## method1:
trans = rg.Transform.Rotation(math.radians(sticky["angle"]), centpt)
geo.Transform(trans)

## method2:
#geo.Rotate(math.pi/sticky["angle"], plane.ZAxis, centpt)

a = geo
# ---------- end python ----------
python_2 = GhPythonScript(state=Toggle(False), crv=crv_2, speed=speed)  # -> out, a; inputs state: Boolean, crv: Curve; disabled
# ---------- python_2: Python ----------
import Rhino.Geometry as rg
import math
from scriptcontext import sticky


if state:
     sticky["angle"] += speed
     a = sticky["angle"]
else:
    sticky["angle"] = 0

#centpt = rg.AreaMassProperties.Compute(x).Centroid
#plane = rg.Plane(centpt, rs.coerce3dvector([0, 0, 1]))
#geo = x
#
## method1:
#trans = rg.Transform.Rotation(math.pi/y, centpt)
#geo.Transform(trans)
#
## method2:
#geo.Rotate(math.pi/y, plane.ZAxis, centpt)
# ---------- end python_2 ----------
crv_4 = Curve(python.a)
rotate = Rotate(Geometry=crv_2, Angle=degrees(python_2.a), Plane=PlaneXY(0, 0, 0))  # -> Geometry, Transform
area = Area(Geometry=[crv_3, crv])  # -> Area, Centroid
gear_simulator = GearSimulator(Driver=crv_4, Follower=[crv_3, crv], Anchor=area.Centroid, Reset=Button())  # -> Follower, Extra
crv_5 = Curve(gear_simulator.Follower)
Z = UnitZ(Factor=1)
extr = Extrude(Base=[crv_5, crv_4], Direction=Z)
cap = CapHoles(Brep=extr)
preview = CustomPreview(
    Geometry=cap,
    Material={diffuse=RGB(221, 160, 221), emission=RGB(66, 48, 66), shine=0.5, specular=RGB(255, 255, 255), transparency=0})
