# Grasshopper definition MarshmallowCollide.gh (Grasshopper 1.0.7)
# plug-ins: Kangaroo2 Components

number_slider = Slider(3, range=0..10)
number_slider_2 = Slider(1, range=0..100)
number_slider_3 = Slider(300, range=0..400)
brep = Brep(<brep referenced from the Rhino model>)
neg = Negative(Value=Slider(1, range=0..1))
popgeo = PopulateGeometry(Geometry=brep, Count=number_slider_3, Seed=1)
brep_2 = Brep(<brep referenced from the Rhino model>)
Z = UnitZ(Factor=neg)
sc = SphereCollide(Points=popgeo, Radius=number_slider, Strength=Slider(0.005, range=0..0.01))
spc = SolidPointCollide(Points=popgeo, Solid=brep_2, Interior=False, Unidirectional=True, Strength=Slider(1100, range=0..1100))
load = Load(Point=popgeo, ForceVector=Z, Weighting=Slider(0.005, range=0..0.01))
show = Show(G=popgeo)
bouncysolver = BouncySolver(
    GoalObjects=[show, sc, load, spc],
    Reset=Button(),
    Threshold=1e-15,
    Tolerance=0.0001,
    Damping=0.99,
    Iterations=10,
    On=Toggle(True))  # -> I, V, O
Z_2 = UnitZ(Factor=number_slider)
pt = Point(bouncysolver.O)
subd = SubD(<subd referenced from the Rhino model>)  # disabled
move = Move(Geometry=subd, Motion=pt)  # -> Geometry, Transform
random = Random(Range="{0,180}", Number=number_slider_3, Seed=2)
volume = Volume(Geometry=move.Geometry)  # -> Volume, Centroid
rotate = Rotate(Geometry=move.Geometry, Angle=degrees(random), Plane=volume.Centroid)  # -> Geometry, Transform
move_2 = Move(Geometry=rotate.Geometry, Motion=Z_2)  # -> Geometry, Transform
preview = CustomPreview(Geometry=move_2.Geometry, Material=ColourSwatch(SwatchColor=RGB(252, 235, 235)))
