# Grasshopper definition MarshmallowGenerator.gh (Grasshopper 1.0.7)

srf = Surface(<surface referenced from the Rhino model>)
pop2d = Populate2D(Region=srf, Count=20, Seed=1)
subd = SubD(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)
move = Move(Geometry=subd, Motion=pop2d)  # -> Geometry, Transform
volume = Volume(Geometry=move.Geometry)  # -> Volume, Centroid
random = Random(Range="{0,180}", Number=20, Seed=2)
rotate = Rotate(Geometry=move.Geometry, Angle=degrees(random), Plane=volume.Centroid)  # -> Geometry, Transform
preview = CustomPreview(Geometry=rotate.Geometry, Material=ColourSwatch(SwatchColor=RGB(247, 218, 218)))
