# Grasshopper definition New_Belt_generator.gh (Grasshopper 1.0.7)
# plug-ins: Pufferfish

distance = Slider(150, range=0..1000)
d1 = Slider(37, range=0..100)
d2 = Slider(53, range=0..100)
crv = Curve(<curve referenced from the Rhino model>)
crv_2 = Curve(<curve referenced from the Rhino model>)
divide = DivideCurve(Curve=crv, Count=4, Kinks=False)  # -> Points, Tangents, Parameters
cp = ControlPoints(Curve=crv)  # -> Points, Weights, Knots
python = GhPythonScript(d1=d1, d2=d2, dist=distance)  # -> out, a; inputs d1: Int32, d2: Int32, dist: Int32
# ---------- python: Python ----------
import math

belt_length = ((d1+d2)*math.pi/2) + (d1-d2)*math.asin((d1-d2)/2*dist) + 2 * math.sqrt(dist**2 - 0.25*(d1-d2)**2)

a = belt_length
# ---------- end python ----------
divide_2 = DivideCurve(Curve=crv_2, Count=4, Kinks=False)  # -> Points, Tangents, Parameters
item = ListItem(List=cp.Points, Index=Slider(6, range=0..10), Wrap=True)
item_2 = ListItem(List=cp.Points, Index=0, Wrap=True)  # -> Item, Item1, Item2
shatter = Shatter(Curve=crv, Parameters=divide.Parameters)
panel = Panel(python.a)
tan = TangentLines(Point=item, Circle=crv_2)  # -> Tangent1, Tangent2
shatter_2 = Shatter(Curve=crv_2, Parameters=divide_2.Parameters)
tan_2 = TangentLines(Point=item_2.Item2, Circle=crv_2)  # -> Tangent1, Tangent2
item_3 = ListItem(List=shatter, Index=0, Wrap=True)  # -> Item, Item1, Item2, Item3
item_4 = ListItem(List=shatter_2, Index=0, Wrap=True)  # -> Item, Item1, Item2, Item3
crv_3 = Curve([tan_2.Tangent2, tan.Tangent1])
join = JoinCurves(Curves=flatten([item_3.Item1, item_3.Item2, crv_3, item_4.Item, item_4.Item3]), Preserve=False)  # -> flatten(Curves)
rebcrv = RebuildCurve(Curve=flatten(join), Count=Slider(20, range=0..100), Degree=3, EndTangents=False)
item_5 = ListItem(List=join, Index=0, Wrap=True)
divide_3 = DivideCurve(Curve=rebcrv, Count=Slider(5, range=0..10), Kinks=False)  # -> Points, Tangents, Parameters
polar = ToPolar(Point=divide_3.Points, System=PlaneXY(51.5, 11, 0))  # -> Phi, Theta, Radius
alongcrv = SortAlongCurve(Points=divide_3.Points, Curve=flatten(join))  # -> flatten(Points), Indices
